# Grasshopper definition planar.gh (Grasshopper 1.0.7)

crv = Curve([<curve referenced from the Rhino model> x7])
boundary = BoundarySurfaces(Edges=crv)
Y = UnitY(Factor=1)
extr = Extrude(Base=boundary, Direction=Y)
tri = Triangulate(Mesh=extr)  # -> Mesh, Count
scale = Scale(Geometry=tri.Mesh, Center=Point(0, 0, 0), Factor=Slider(0.2, range=0..1))  # -> Geometry, Transform
