# Grasshopper definition export(1).gh (Grasshopper 1.0.7)

crv = Curve([<curve referenced from the Rhino model> x11])
python = GhPythonScript(Cs=crv)  # -> points; inputs Cs: list of Polyline
# ---------- python: Python ----------
__author__ = "ziqwang"

import rhinoscriptsyntax as rs
import ghpythonlib.components as gh
points = []
for c in Cs:
    _, V = gh.Explode(c, True)
    poly = []
    for pt in V:
        poly.append([pt[0], pt[1]])
    points.append(poly[:-1])
print(points)
# ---------- end python ----------
